# Grasshopper definition Trees_in_Outdoor_Thermal_Comfort.gh (Grasshopper 1.0.7)

panel = Panel("https://www.energyplus.net/weather-download/europe_wmo_region_6/FRA//FRA_Paris.Orly.071490_IWEC/all")
epw_stat = Ladybug_OpenEPWAndSTATWeatherFiles(weatherFileURL=panel)  # -> epwFile, statFile; plug-in component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
importstat = Ladybug_ImportStat(statFile=epw_stat.statFile)  # -> readMe, ashraeClimateZone, koppenClimateZone, heatingDesignTemps, coolingDesignTemps, heatingDesignDay, coolingDesignDay, monthlyTauBeam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; plug-in component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

# ----
# DEFINE GROUND ZONE
ground_zone = Brep(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)
mass2zone = Honeybee_Masses2Zones(zoneMasses=flatten(ground_zone), isConditioned=True, maxRoofAngle=30, createHBZones=Toggle(True))  # -> readMe, HBZones; plug-in component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
soil_type = Panel("2")
createepground = Honeybee_CreateEPGround(HBZones=mass2zone.HBZones, soilTypeOrMat=soil_type)  # -> HBGrndZones; plug-in component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

# ----
# DEFINE TREE
# CHARACTERISTICS
treecanopytransmittance = Panel("0.5")
evaluation_surface = Brep(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)
tree_trunk = Brep(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)
tree_canopy = Brep(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)

# ----
# SELECT WEATHER FILE + RUN PERIOD
honeybee = Honeybee_Honeybee()  # -> Vviiiiiiiiiizzz; plug-in component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
ladybug = Ladybug_Ladybug()  # -> Vviiiiiiiiiizzz; plug-in component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

# ---- group: Factor in Tree for Energy Simulation
constantschedule = Honeybee_ConstantSchedule(value=treecanopytransmittance, scheduleName="TreeTransP")  # -> readMe, schedule, weekSched, schedIDFText; plug-in component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
hb_epcontextsrf = HoneybeeEPContextSurfaces(shdSurfaces=flatten(tree_trunk))  # -> HBContext; inputs shdSurfaces: list of Brep, justBoundingBox: Boolean
# ---------- hb_epcontextsrf: Python ----------
"""
prepare shading/context geometries

    Args:
        northVectorOrRotation: A vector that shows North or a number that shows
                               the rotation of the North from the Y axis
        bldgMasses: List of closed Breps as thermal zones.
    Returns:
        report: ...
        thermalZones: Thermal zone's geometries for visualiza
"""

ghenv.Component.Name = 'Honeybee EP context Surfaces'
ghenv.Component.NickName = 'HB_EPContextSrf'
ghenv.Component.Message = 'VER 0.0.65\nJAN_01_2020'
ghenv.Component.IconDisplayMode = ghenv.Component.IconDisplayMode.application
ghenv.Component.Category = "Honeybee"
ghenv.Component.SubCategory = "10 | Energy | Energy"
#compatibleHBVersion = VER 0.0.57\nNOV_04_2016
#compatibleLBVersion = VER 0.0.59\nFEB_01_2015
ghenv.Component.AdditionalHelpFromDocStrings = "2"

import rhinoscriptsyntax as rs
import Rhino as rc
import scriptcontext as sc
import os
import System
import Grasshopper.Kernel as gh
import uuid

tolerance = sc.doc.ModelAbsoluteTolerance
import math


def main(shdSurfaces, EPTransSchedule, meshingSettings, justBoundingBox):
    
    # import the classes
    if sc.sticky.has_key('honeybee_release'):

        try:
            if not sc.sticky['honeybee_release'].isCompatible(ghenv.Component): return -1
            if sc.sticky['honeybee_release'].isInputMissing(ghenv.Component): return -1
        except:
            warning = "You need a newer version of Honeybee to use this compoent." + \
            " Use updateHoneybee component to update userObjects.\n" + \
            "If you have already updated userObjects drag Honeybee_Honeybee component " + \
            "into canvas and try again."
            w = gh.GH_RuntimeMessageLevel.Warning
            ghenv.Component.AddRuntimeMessage(w, warning)
            return -1
        
        # don't customize this part
        hb_EPSrf = sc.sticky["honeybee_EPSurface"]
        hb_EPSHDSurface = sc.sticky["honeybee_EPShdSurface"]
        hb_RADMaterialAUX = sc.sticky["honeybee_RADMaterialAUX"]
        hb_EPObjectsAux = sc.sticky["honeybee_EPObjectsAUX"]()
        HBScheduleList = sc.sticky["honeybee_ScheduleLib"].keys()

        ########################################################################
        #----------------------------------------------------------------------#
        shdBreps = []
        # create bounding box of shading geometries
        if justBoundingBox:
            for brep in shdSurfaces:
                if brep.Faces.Count>1 or not brep.Faces[0].IsPlanar(sc.doc.ModelAbsoluteTolerance):
                    shdBreps.append(brep.GetBoundingBox(True).ToBrep())
                else:
                    shdBreps.append(brep)
        else:
            shdBreps = shdSurfaces
        
        shadingClasses = []
        shadingMeshPreview = []
        
        if meshingSettings == None:
            mp = rc.Geometry.MeshingParameters.Minimal
            mp.SimplePlanes = True
        else:
            mp = meshingSettings
        
        def getRadMaterialName(radMaterial):
            nameStr = radMaterial.split(" ")[2]
            name =  nameStr.split("\n")[0]
            return name
        
        for brepCount, brep in enumerate(shdBreps):
            if brep != None:
                isPlanar = True
                # check planarity
                for face in brep.Faces:
                    if not face.IsPlanar(tolerance):
                        isPlanar = False
                        break
                
                shadingBreps = []
                if not isPlanar:
                    meshArray = rc.Geometry.Mesh.CreateFromBrep(brep, mp)
                    for mesh in meshArray:
                        for meshFace in range(mesh.Faces.Count):
                            vertices = list(mesh.Faces.GetFaceVertices(meshFace))[1:]
                            vertices = vertices + [sc.doc.ModelAbsoluteTolerance]
                            # create the brep from mesh
                            shdBrep = rc.Geometry.Brep.CreateFromCornerPoints(*vertices)
                            shadingBreps.append(shdBrep)
                else:
                    for face in brep.Faces:
                        shadingBreps.append(face.DuplicateFace(False))
                
                for faceCount, shdBrep in enumerate(shadingBreps):
                        thisShading = hb_EPSHDSurface(shdBrep, 1000*brepCount + faceCount, 'shdSrf_' + `brepCount` + '_' + `faceCount` + "_" + str(uuid.uuid4()))
                        
                        # add transmittance schedule if any
                        if EPTransSchedule!=None:
                            schedule= EPTransSchedule.upper()
                            if schedule!=None and not schedule.lower().endswith(".csv") and schedule not in HBScheduleList:
                                msg = "Cannot find " + schedule + " in Honeybee schedule library."
                                print msg
                                ghenv.Component.AddRuntimeMessage(gh.GH_RuntimeMessageLevel.Warning, msg)
                                return -1
                            elif schedule!=None and schedule.lower().endswith(".csv"):
                                # check if csv file is existed
                                if not os.path.isfile(schedule):
                                    msg = "Cannot find the shchedule file: " + schedule
                                    print msg
                                    ghenv.Component.AddRuntimeMessage(gh.GH_RuntimeMessageLevel.Warning, msg)
                                    return -1
                            
                            thisShading.TransmittanceSCH = schedule
                        
                        # add the Rad Material if any
                        if RADMaterial!=None:
                            # if it is just the name of the material make sure it is already defined
                            if len(RADMaterial.split(" ")) == 1:
                                # if the material is not in the library add it to the library
                                if not hb_RADMaterialAUX.isMatrialExistInLibrary(RADMaterial):
                                    warningMsg = "Can't find " + RADMaterial + " in RAD Material Library.\n" + \
                                                "Add the material to the library and try again."
                                    ghenv.Component.AddRuntimeMessage(gh.GH_RuntimeMessageLevel.Warning, warningMsg)
                                    return
                                
                                try:
                                    thisShading.setRADMaterial(RADMaterial)
                                except Exception, e:
                                    print e
                                    warningMsg = "You are using an old version of Honeybee_Honeybee! Update your files and try again."
                                    print warningMsg
                                    ghenv.Component.AddRuntimeMessage(gh.GH_RuntimeMessageLevel.Warning, warningMsg)
                                    return
                                
                                addedToLib = True
                            else:
                                
                                # try to add the material to the library
                                addedToLib, thisShading.RadMaterial = hb_RADMaterialAUX.analyseRadMaterials(RADMaterial, True)
                                
                            if addedToLib==False:
                                warningMsg = "Failed to add " + RADMaterial + " to the Library."
                                ghenv.Component.AddRuntimeMessage(gh.GH_RuntimeMessageLevel.Warning, warningMsg)
                                return
                        
                        # add shading to the list
                        shadingClasses.append(thisShading)
                
        # add to the hive
        hb_hive = sc.sticky["honeybee_Hive"]()
        HBContext  = hb_hive.addToHoneybeeHive(shadingClasses, ghenv.Component)
        return HBContext
        ################################################################################################
    else:
        print "You should first let Honeybee to fly..."
        w = gh.GH_RuntimeMessageLevel.Warning
        ghenv.Component.AddRuntimeMessage(w, "You should first let Honeybee to fly...")
        return -1
        

if _shdSurfaces and _shdSurfaces[0]!=None:
    # add cleaning function
    result= main(_shdSurfaces, EPTransSchedule_, meshingSettings_, justBoundingBox_)
    
    if result != -1: HBContext = result
# ---------- end hb_epcontextsrf ----------
hb_epcontextsrf_2 = HoneybeeEPContextSurfaces(shdSurfaces=flatten(tree_canopy), EPTransSchedule=constantschedule.schedule)  # -> HBContext; inputs shdSurfaces: list of Brep, justBoundingBox: Boolean; same code as hb_epcontextsrf

# ----
# Visualize Geometry
swatch = ColourSwatch(SwatchColor=RGB(97, 79, 45))
preview = CustomPreview(Geometry=createepground, Shader=swatch)
preview_2 = CustomPreview(Geometry=tree_canopy, Shader=ColourSwatch(SwatchColor=RGBA(46, 171, 79, 147)))
preview_3 = CustomPreview(Geometry=tree_trunk, Shader=ColourSwatch(SwatchColor=RGB(166, 134, 76)))

panel_2 = Panel("""OutputControl:Table:Style,Comma;
Output:Variable,*,Surface Outside Face Temperature, hourly;""")
data = Data(flatten(["0", treecanopytransmittance]))
geo = Geometry(flatten([tree_trunk, tree_canopy]))
# 2
toggle = BooleanToggle(False)

# ----
# CALCULATE
# VIEW FACTORS
toggle_2 = BooleanToggle(True)
indoorviewfactor = Honeybee_IndoorViewFactorCalculator(
    HBZones=flatten(createepground),
    gridSize="0.5",
    distFromFloorOrSrf=flatten(evaluation_surface),
    additionalShading=flatten(geo),
    addShdTransmiss=flatten(data),
    includeOutdoor=Toggle(True),
    parallel=toggle_2,
    buildMesh=toggle,
    runIt=toggle)  # -> readMe, port, viewFactorMesh, viewFactorInfo, port_2, testPts, viewMeshFaces, zoneWireFrame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; plug-in component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

# ----
# 1
toggle_3 = BooleanToggle(False)

# ----
# RUN ENERGY SIM
exporttoopenstudio = Honeybee_ExportToOpenStudio(
    epwWeatherFile=epw_stat.epwFile,
    analysisPeriod=importstat.extremeHotWeek,
    HBZones=flatten(createepground),
    HBContext=flatten([hb_epcontextsrf, hb_epcontextsrf_2]),
    simulationOutputs=flatten(panel_2),
    writeOSM=toggle_3,
    runSimulation=toggle_3)  # -> readMe, osmFileAddress, idfFileAddress, resultFileAddress, eioFileAddress, rddFileAddress, htmlReport, studyFolder, model; plug-in component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
readepsrfresult = Honeybee_ReadEPSurfaceResult(resultFileAddress=exporttoopenstudio.resultFileAddress)  # -> surfaceIndoorTemp, surfaceOutdoorTemp, surfaceEnergyFlow, opaqueEnergyFlow, glazEnergyFlow, windowTotalSolarEnergy, windowBeamEnergy, windowDiffEnergy, windowTransmissivity; plug-in component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

# ----
# 3
toggle_4 = BooleanToggle(False)

# ----
# RUN MICROCLIMATE MAP
outdoorcomfrecipe = Honeybee_OutdoorComfortAnalysisRecipe(
    viewFactorMesh=indoorviewfactor.viewFactorMesh,
    viewFactorInfo=indoorviewfactor.viewFactorInfo,
    epwFile=epw_stat.epwFile,
    srfOutdoorTemp=readepsrfresult.surfaceOutdoorTemp)  # -> comfRecipe; plug-in component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
microclimatemap = Honeybee_MicroclimateMapAnalysis(comfAnalysisRecipe=outdoorcomfrecipe, analysisPeriodOrHOY=importstat.extremeHotWeek, parallel=toggle_4, runIt=toggle_4)  # -> readMe, port, radTempMtx, airTempMtx, operativeTempMtx, adaptComfMtx, degFromTargetMtx, port_2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; plug-in component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

# ----
# Scroll Through the Hours of the Simulation
# VISUALIZE MICROCLIMATE MAP
number_slider = Slider(24, range=1..24)
visualizemicroclimate = Honeybee_VisualizeMicroclimateMap(comfResultsMtx=microclimatemap.operativeTempMtx, viewFactorMesh=flatten(indoorviewfactor.viewFactorMesh))  # -> readMe, port, resultMesh, legend, legendBasePt, port_2, resultValues, resultColors; plug-in component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
