# Grasshopper definition analise_estrutural_basica.gh (Grasshopper 1.0.7)
# Copyright: B+G Engineers
# plug-ins: karambaGH

list_item = ListItem(List=[8, 10, 12, 15], Index=0, Wrap=True)  # -> Item, Item1, Item2, Item3

# ----
# Análise estrutural simples
# Difficulty: Simple
# A single span beam with two supports and a uniform line load is analyzed using the cross section optimizer to find the optimal cross sections for each element. The moment section forces can be visualized in the Beam View component.
# The FREE version does not include the Cross Section Optimizer.
# NOTAS:
# 
# 1. MEDIDAS EM MILÍMETROS:
# 2. ESTRUTURA EM AÇO DE BAIXA E ALTA RESISTÊNCIA MECÂNICA E RESISTENTE A CORROSÃO ATMOSFÉRICA TIPO ASTM A588 COM LIMITE DE ESCOAMENTO Fy>345MPa, EXCETO OS CONECTORES EM U LAMINADO TIPO ASTM A36 COM Fy>250MPa;
# 3. CONCRETO DA LAJE FCK>250MPa;
# 4. ESTRUTURA SOLDADA NA OFICINA E PARAFUSADA NO CAMPO COM PARAFUSOS ASTM A325F TIPO 3 OU GALVANIZADOS; ELETRODO E70XX (RAIZ E ENCHIMENTO0 E E8018G (ACABAM.) AWS CODE D1,1/04
# 5. ESTRUTURA PROJETADA PARA TREM TIPO CLASSE 45t;
# 6. A ESTRUTURA DEVERÁ SER LIMPA PARA UNIFORMIZAÇÃO DA SUPERFÍCIE ATRAVÉS DE JATO COMERCIAL TIPO SSPC-SP6;
# 7. PESO ESTIMADO POR PONTE 1.1814 KG.
# 
# 
# https://www.karamba3d.com/examples/simple/single-span-beam/
panel = Panel("SIMPLES BEAM")

number_slider = Slider(1, range=0..2)  # disabled
number_slider_2 = Slider(5, range=0..10)  # disabled
number_slider_3 = Slider(1, range=0..10)  # disabled
number_slider_4 = Slider(3, range=0..10)  # disabled
python = PythonScript(spacing=number_slider, zNum=number_slider_3, yNum=number_slider_2)  # -> out, bars, braces, supports, load; disabled
# ---------- python: Python ----------
import Rhino.Geometry as rh

points = []

for y in range(int(yNum+1)):
    points.append([])
    for z in range(int(zNum+1)):
        points[-1].append(rh.Point3d(0, y*spacing, z*spacing))

bars = []
braces = []

for i in range(len(points)):
    for j in range(len(points[i])):
        if i < len(points) - 1:
            bars.append(rh.Line(points[i][j], points[i+1][j]))
        
        if j < len(points[i]) - 1:
            bars.append(rh.Line(points[i][j], points[i][j+1]))
        
        if i < len(points) - 1 and j < len(points[i]) - 1:
            braces.append(rh.Line(points[i][j], points[i+1][j+1]))
        
        if i > 0 and j < len(points[i]) - 1:
            braces.append(rh.Line(points[i][j], points[i-1][j+1]))

supports = points[:][0]
load = points[-1][-1]
# ---------- end python ----------
line = Line(python.bars)  # disabled
line_2 = Line(python.braces)  # disabled
pt = Point(python.supports)  # disabled
pt_2 = Point(python.load)  # disabled
number_slider_5 = Slider(1, range=0..10)  # disabled
rdlines = RemoveDuplicateLinesKaramba(Line=line, LimitDistance=0.005)  # -> OutLine, Info, Indexes; disabled
rdlines_2 = RemoveDuplicateLinesKaramba(Line=line_2, LimitDistance=0.005)  # -> OutLine, Info, Indexes; disabled
panel_2 = Panel("-25")  # disabled
panel_3 = Panel("bars")  # disabled
cross_sections = CrossSectionsKaramba(
    ElementsIdentifiers=panel_3,
    Height_cm=number_slider_4,
    UpperFlangeWidth_cm=number_slider_4,
    LowerFlangeWidth_cm=number_slider_4,
    mode="Trapezoid")  # disabled
panel_4 = Panel("braces")  # disabled
llinter = LineLineIntersectionKaramba(Line=rdlines.OutLine, LengthTolerance=0.01)  # -> IntersectionPoints, flatten(LineSubSegements); disabled
llinter_2 = LineLineIntersectionKaramba(Line=rdlines_2.OutLine, LengthTolerance=0.01)  # -> IntersectionPoints, flatten(LineSubSegements); disabled
Z = UnitZ(Factor=panel_2)  # disabled
matselect = MaterialSelectionKaramba(menu=[dropdown(1), dropdown(1)])  # disabled
cross_sections_2 = CrossSectionsKaramba(
    ElementsIdentifiers=panel_4,
    Height_cm=number_slider_5,
    UpperFlangeWidth_cm=number_slider_5,
    LowerFlangeWidth_cm=number_slider_5,
    mode="Trapezoid")  # disabled
supp = SupportKaramba(PosInd=pt, menu=[buttons(on, on, on, off, off, on)])  # disabled
loads = LoadsKaramba(ForceVector=Z, Local=False, PosInd=pt_2, LCase=0, mode="Point")  # disabled
linetobeam = LineToBeamKaramba(Line=llinter.LineSubSegements, New=True, Remove=True, LimitDistance_m=0.005, BeamIdentifier=panel_3)  # -> Points, Element, Info; disabled
linetobeam_2 = LineToBeamKaramba(Line=llinter_2.LineSubSegements, New=True, Remove=True, LimitDistance_m=0.005, BeamIdentifier=panel_4)  # -> Points, Element, Info; disabled
merge = Merge(Data1=cross_sections, Data2=cross_sections_2)  # disabled
merge_2 = Merge(Data1=linetobeam.Element, Data2=linetobeam_2.Element)  # disabled
range = Range(Domain=Domain(0, 1), Steps=10)  # disabled
gradient = Gradient(LowerLimit=0, UpperLimit=1, Parameter=range, stops=[0: RGB(0, 128, 0), 0.5: RGB(255, 255, 0), 1: RGB(255, 0, 0)])  # disabled
assemble = AssembleModelKaramba(Elem=merge_2, Support=supp, Load=loads, CrossSection=merge, Material=matselect, LimitDistance_m=0.005)  # -> Model, Info, Mass_kg, CenterOfGravity; disabled
model_mass_kg = Panel(assemble.Mass_kg)  # disabled
analyzethi = AnalyzeThIKaramba(Model=assemble.Model)  # -> CalculatedModel, MaximumDisplacement_m, ResultingForceOfGravity_kN, ElasticEnergy_kNm; disabled
max_displacement_m = Panel(analyzethi.MaximumDisplacement_m)  # disabled
modelview = ModelViewKaramba(
    Model=analyzethi.CalculatedModel,
    LoadCaseFactorsForLinearSuperposition=1,
    IndexIncrementOfVisibleLoadcase=0,
    ListOfColorsForColoringPlots=gradient)  # -> Model, DeformedMesh, DeformedAxes, DeformedModel; disabled
beamview = BeamViewKaramba(Model=modelview.Model)  # -> Model, MeshesOfRenderedBeams, DeformedBeamAxes, LegendColors, LegendTags; disabled
b_res_force = BeamResultantForcesKaramba(AnalyzedModel=beamview.Model, LoadCase=-1, MaximumProbingDistance_m=-1, NumberOfProbingPointsPerElement=3)  # -> AnalyzedModel, NormalForce_kN, ResultantBendingMoment_kNm, ResultantShearForce_kN; disabled
python_2 = PythonScript(x=beamview.LegendTags)  # -> out, a; inputs x: list; disabled
# ---------- python_2: Python ----------
import re

a = []

x.pop(0)

for val in x:
    try:
        a.append( float(re.sub(r'[^\d.-e+]+', '', val)) )
    except ValueError:
        continue
# ---------- end python_2 ----------
abs = Absolute(Value=python_2.a)  # disabled
bnd = Bounds(Numbers=b_res_force.NormalForce_kN)  # disabled
bnd_2 = Bounds(Numbers=b_res_force.ResultantBendingMoment_kNm)  # disabled
bnd_3 = Bounds(Numbers=b_res_force.ResultantShearForce_kN)  # disabled
bnd_4 = Bounds(Numbers=abs)  # disabled
dedomain = DeconstructDomain(Domain=bnd)  # -> Start, End; disabled
dedomain_2 = DeconstructDomain(Domain=bnd_2)  # -> Start, End; disabled
dedomain_3 = DeconstructDomain(Domain=bnd_3)  # -> Start, End; disabled
dedomain_4 = DeconstructDomain(Domain=bnd_4)  # -> Start, End; disabled
abs_2 = Absolute(Value=dedomain.Start)  # disabled
max_utilization_percentage = Panel(dedomain_4.End)  # disabled
max_compression_kn = Panel(abs_2)  # disabled
max_tension_kn = Panel(dedomain.End)  # disabled
max_moment_knm = Panel(dedomain_2.End)  # disabled
max_shear_kn = Panel(dedomain_3.End)  # disabled

# ---- group: Define Materials
matselect_2 = MaterialSelectionKaramba3D(menu=[dropdown(1), dropdown(7)])

# ---- group: Define Cross Sections
crosecrselect = CrossSectionRangeSelectorKaramba3D(MaximumHeight_cm=-1, MaximumWidth_cm=-1, menu=[dropdown(12), dropdown(1), dropdown(3)])
i = Slider(0, range=0..10)
crosecselect = CrossSectionSelectorKaramba3D(CrossSections=crosecrselect, NameOrListIndexOfCrossSection=i, Material=matselect_2)  # -> CrossSection, Info

# ----
panel_5 = Panel(crosecselect.CrossSection)

# ---- group: Define Loads
f = Slider(-0.8, range=-10..10)
unit_z = UnitZ(Factor="-0.1")
Z_2 = UnitZ(Factor=f)
loads_karamba3d = LoadsKaramba3D(Vector=unit_z, LCase=0, mode="Gravity")
loads_karamba3d_2 = LoadsKaramba3D(Vector=Z_2, BeamIdentifiers="BeamA", LCase=0, mode="Uniform Line", menu=[buttons(off, on, off)])

# ----
range_2 = Range(Domain=Domain(0, 1), Steps=10)
gradient_2 = Gradient(LowerLimit=0, UpperLimit=1, Parameter=range_2, stops=[0: RGB(0, 128, 0), 0.5: RGB(255, 255, 0), 1: RGB(255, 0, 0)])

# ---- group: Create Geometry
construct_point = ConstructPoint(XCoordinate=0, YCoordinate="2.6", ZCoordinate=0)
construct_point_2 = ConstructPoint(XCoordinate=list_item.Item, YCoordinate="2.6", ZCoordinate=0)
construct_point_3 = ConstructPoint(XCoordinate=0, YCoordinate=0, ZCoordinate=0)
construct_point_4 = ConstructPoint(XCoordinate=list_item.Item, YCoordinate=0, ZCoordinate=0)

# ---- group: Create Geometry / Comprimento
aligndim = AlignedDimension(Plane=PlaneXY(0, 0, 0), PointA=construct_point_3, PointB=construct_point_4, Offset=-2, Text="{0:0.00}", Size=0.2)

# ---- group: Create Geometry / Largura
aligndim_2 = AlignedDimension(Plane=PlaneXY(0, 0, 0), PointA=construct_point_4, PointB=construct_point_2, Offset=-2, Text="{0:0.00}", Size=0.2)

# ---- group: Create Geometry / BeamA
ln = Line(StartPoint=construct_point, EndPoint=construct_point_2)
ln_2 = Line(StartPoint=construct_point_3, EndPoint=construct_point_4)

# ---- group: Create Geometry (continued)
divide_curve = DivideCurve(Curve=ln, Count="2", Kinks=False)  # -> Points, Tangents, Parameters
divide_curve_2 = DivideCurve(Curve=ln_2, Count="2", Kinks=False)  # -> Points, Tangents, Parameters

# ---- group: Create Geometry / BeamB
line_3 = Line(StartPoint=divide_curve_2.Points, EndPoint=divide_curve.Points)

# ----
merge_3 = Merge(Data1=ln_2, Data2=ln)

# ---- group: Apoios
point = Point([construct_point_3, construct_point_4, construct_point, construct_point_2])

# ---- group: Define Supports
hframe = HorizontalFrame(Curve=merge_3, Parameter=0)
supp_2 = SupportKaramba(PosInd=point, PlaneOfReference=hframe, menu=[buttons(on, on, on, on, off, off)])

# ---- group: Define Elements
linetobeam_3 = LineToBeamKaramba3D(
    Line=merge_3,
    Color=ColourSwatch(SwatchColor=RGB(0, 42, 255)),
    Identifier="BeamA",
    CrossSection=crosecselect.CrossSection,
    New=True,
    Remove=True,
    LimitDistance_m=0.005)  # -> Element, Points, Info

# ---- group: Assemble Model
assemble_2 = AssembleModelKaramba3D(Elem=linetobeam_3.Element, Support=supp_2, Load=[loads_karamba3d, loads_karamba3d_2], LimitDistance_m=0.005)  # -> Model, Info, Mass_kg, CenterOfGravity

# ----
model_mass_kg_2 = Panel(assemble_2.Mass_kg)

# ---- group: Analyze Model
analyze = AnalyzeKaramba3D(Model=assemble_2.Model)  # -> CalculatedModel, MaximumDisplacement_cm, ResultingForceOfGravity_kN, ElasticEnergy_kNm
max_displacement_m_2 = Panel(analyze.MaximumDisplacement_cm)

# ---- group: View Results
modelview_2 = ModelViewKaramba3D(Model=analyze.CalculatedModel, LoadCaseFactorsForLinearSuperposition=1, IndexOfVisibleLoadcase=-1)  # -> Model, DeformedMesh, DeformedAxes, DeformedModel
beamview_2 = BeamViewKaramba3D(Model=modelview_2.Model)  # -> Model, MeshesOfRenderedBeams, DeformedBeamAxes, LegendColors, LegendTags
legend = Legend(Colour=beamview_2.LegendColors, Tags=beamview_2.LegendTags, LegendType=1)

# ----
python_3 = PythonScript(x=beamview_2.LegendTags)  # -> out, a; inputs x: list; same code as python_2
b_res_force_2 = BeamResultantForcesKaramba(AnalyzedModel=beamview_2.Model, LoadCase=-1, MaximumProbingDistance_m=-1, NumberOfProbingPointsPerElement=3)  # -> AnalyzedModel, NormalForce_kN, ResultantBendingMoment_kNm, ResultantShearForce_kN
abs_3 = Absolute(Value=python_3.a)

# ---- group: Não é uma treliça
bnd_5 = Bounds(Numbers=b_res_force_2.NormalForce_kN)
dedomain_5 = DeconstructDomain(Domain=bnd_5)  # -> Start, End
abs_4 = Absolute(Value=dedomain_5.Start)
max_tension_kn_2 = Panel(dedomain_5.End)
max_compression_kn_2 = Panel(abs_4)

# ----
bnd_6 = Bounds(Numbers=b_res_force_2.ResultantBendingMoment_kNm)
bnd_7 = Bounds(Numbers=b_res_force_2.ResultantShearForce_kN)
bnd_8 = Bounds(Numbers=abs_3)
dedomain_6 = DeconstructDomain(Domain=bnd_6)  # -> Start, End
dedomain_7 = DeconstructDomain(Domain=bnd_7)  # -> Start, End
dedomain_8 = DeconstructDomain(Domain=bnd_8)  # -> Start, End
max_utilization_percentage_2 = Panel(dedomain_8.End)
max_shear_kn_2 = Panel(dedomain_7.End)
max_moment_knm_2 = Panel(dedomain_6.End)
